# Grasshopper definition Pile optimisation.gh (Grasshopper 1.0.7)
# Copyright: © 2017-2018 Pierre Cuvilliers, Caitlin Mueller, Massachusetts Institute of Technology
# plug-ins: Pufferfish, EleFront, Dodo, LunchBox

panel = Panel("(volume * 8416.94511474 - Count * 53.36874700563749 + Summary_length * 650)/10^6")
number_slider = Slider(1000, range=0..1000)
text = Text(panel)
series = Series(Start=0, Step=number_slider, Count=Slider(9, range=0..10))
rectangle = Rectangle({Plane=PlaneXY(-130529.8048, -1445.838941, 0), Size=Domain2(u=-15595.7934..15595.7934, v=-31892.52134..31892.52134)})
curve = Curve(rectangle)
unit_z = UnitZ(Factor=series)
explode = Explode(Curve=curve, Recursive=True)  # -> Segments, Vertices
multiplication = Multiplication(A=series, B=number_slider, C=1e-05)

# ----
# Enable this before
# background python start
panel_2 = Panel("C://ProgramData//Anaconda3//envs//rhinoremote")  # disabled
panel_3 = Panel("""numpy
scipy
numpy.linalg
pandas
sklearn.preprocessing""")  # disabled
toggle = BooleanToggle(False)  # disabled
gh_python_remote = GHPythonRemote(location=panel_2, run=toggle, modules=panel_3)  # -> out, linked_modules, rpy, import_statements; disabled
panel_4 = Panel(gh_python_remote.linked_modules)  # disabled
panel_5 = Panel(gh_python_remote.import_statements)  # disabled
panel_6 = Panel(gh_python_remote.out)  # disabled

# ----
# Reading data from Autocad
panel_7 = Panel("ren_column")
reference_by_layer = ReferenceByLayer(LayerName=panel_7)
reference_by_layer_2 = ReferenceByLayer(LayerName="N")
filter_by_type = FilterByType(Geometry=reference_by_layer_2, ObjectType="Text")
join_curves = JoinCurves(Curves=reference_by_layer, Preserve=False)
deconstruct_text = DeconstructText(TextObject=filter_by_type)  # -> Text, Plane, Height, Justification
null_item = NullItem(Item=filter_by_type)  # -> NullFlags, InvalidFlags, Description
area = Area(Geometry=join_curves)  # -> Area, Centroid
match_text = MatchText(Text=deconstruct_text.Text, RegEx="\d*\;\d*", Case=True)
gate_or = GateOr(A=null_item.NullFlags, B=match_text)
cull_pattern = CullPattern(List=deconstruct_text.Plane, CullPattern=invert(gate_or))
cull_pattern_2 = CullPattern(List=deconstruct_text.Text, CullPattern=invert(gate_or))
move = Move(Geometry=cull_pattern, Motion=Vector(400, 550, 0))  # -> Geometry, Transform
panel_8 = Panel(cull_pattern_2)
closest_point = ClosestPoint(Point=move.Geometry, Cloud=area.Centroid)  # -> ClosestPoint, CPIndex, Distance
point_groups = PointGroups(Points=closest_point.ClosestPoint, Distance=1200)  # -> simplify(Groups), Indices
list_item = ListItem(List=cull_pattern_2, Index=point_groups.Indices, Wrap=True)
average_plane = AveragePlane(Planes=point_groups.Groups)  # -> flatten(ArithmeticMean)
mass_addition = MassAddition(Input=list_item)  # -> flatten(Result), PartialResults
text_tag_3d = TextTag3D(Location=closest_point.ClosestPoint, Text=cull_pattern_2, Size=500, Justification=7)
number = Number(mass_addition.Result)

number_2 = Number(number)
weighted_average_plane = WeightedAveragePlane(Planes=point_groups.Groups, Weights=list_item)  # -> flatten(ArithmeticMean)

plane = Plane(weighted_average_plane)
text_tag_3d_2 = TextTag3D(Location=plane, Text=mass_addition.Result, Size=500, Justification=7)

plane_2 = Plane(plane)
plane_3 = Plane(plane)

# ----
# Pile groups generator
number_slider_2 = Slider(6, range=0..10)
curve_2 = Curve([<curve referenced from the Rhino model> x88])
join_curves_2 = JoinCurves(Curves=curve_2, Preserve=False)
series_2 = Series(Start=3, Step=1, Count=number_slider_2)
series_3 = Series(Start=1, Step=1, Count=number_slider_2)
series_4 = Series(Start=2, Step=1, Count=number_slider_2)
area_2 = Area(Geometry=join_curves_2)  # -> Area, Centroid
longest_list = LongestList(ListListA=series_3, ListListB=[series_3, series_4, series_2], PaddingMode=4)  # -> ListListA, ListListB
point = Point(Point(0, 0, 0))
average_plane_2 = AveragePlane(Planes=area_2.Centroid)
square = Square(Plane=PlaneXY(0, 0, 0), Size=1000, ExtentX=graft(longest_list.ListListA), ExtentY=graft(longest_list.ListListB))  # -> Cells, simplify(Points)
number_slider_3 = Slider(15, range=0..18)
concatenate = Concatenate(Fragment_A=longest_list.ListListA, A="x", Fragment_B=longest_list.ListListB)  # -> simplify(graft(Result))
vector_2pt = Vector2Pt(PointA=average_plane_2, PointB=area_2.Centroid, Unitize=False)  # -> Vector, Length
path_mapper = PathMapper(square.Points, source="{A;B}", target="{A}")
vector_display = VectorDisplay(Anchor=average_plane_2, Vector=vector_2pt.Vector)
deconstruct_vector = DeconstructVector(Vector=vector_2pt.Vector)  # -> XComponent, YComponent, ZComponent
ghpython_script = GhPythonScript(x=deconstruct_vector.XComponent, y=deconstruct_vector.YComponent)  # -> out, sqr_x, sqr_y, max_x, max_y, W_x, W_y, counter; inputs x: list, y: list
# ---------- ghpython_script: Python ----------
__author__ = "panedviga"
__version__ = "2020.09.09"

import rhinoscriptsyntax as rs
import Rhino.Geometry

sqr_x = sum(map(lambda n: (n/1000) ** 2, y))
sqr_y = sum(map(lambda n: (n/1000) ** 2, x))
max_x = max(map(lambda n: abs(n/1000), x))
max_y = max(map(lambda n: abs(n/1000), y))
W_x = max_x/sqr_x
W_y = max_y/sqr_y
a = len(x)
# ---------- end ghpython_script ----------
panel_9 = Panel("""pattern_type
pile_count
sum_sqr_x
sum_sqr_y
max_x
max_y
W_x
W_y
x_count
y_count""")

integer = Integer(simplify(graft(longest_list.ListListB)))
integer_2 = Integer(simplify(graft(longest_list.ListListA)))

# ----
# Variance optimisation surface (preliminary optimisation hyperparameter results based only on vertical forces)
number_slider_4 = Slider(27, range=0..100)
file_path = FilePath("C:\Users\panedviga\01_Python code\Pile_optimisation\pile_bc.csv")
read_file = ReadFile(File=file_path, PerLineParse=True)
series_5 = Series(Start=1, Step=1, Count=6)
length_m = Slider(16, range=10..36, expression="x*0.5")
read_csv = ReadCSV(CSVString=read_file, Delimiter=",")  # -> Headers, Values
series_6 = Series(Start=Slider(5, range=0..10), Step=0.5, Count=number_slider_4)
integer_3 = Integer(series_5)
sub_list = SubList(List=read_csv.Values, Domain=Domain(1, 180), Wrap=True)  # -> simplify(List), Index
construct_path = ConstructPath(Indices=graft(integer_3))
construct_path_2 = ConstructPath(Indices=0)
list_length = ListLength(List=integer_3)
number_3 = Number(series_6)
list_item_2 = ListItem(List=read_csv.Headers, Index=integer_3, Wrap=True)
tree_branch = TreeBranch(Tree=sub_list.List, Path=construct_path_2, MaintainPaths=True)
tree_branch_2 = TreeBranch(Tree=sub_list.List, Path=construct_path, MaintainPaths=True)
evaluate = Evaluate(Expression="round(x*10)", x=number_3)
evaluate_2 = Evaluate(Expression="round(x*10)", x=tree_branch)
key_value_search = KeyValueSearch(Keys=evaluate_2, Values=tree_branch_2, Search=evaluate)  # -> simplify(Result)
quick_graph = QuickGraph(tree_branch_2, SortOrder=0)
panel_10 = Panel(list_item_2)
n_kn = Panel(key_value_search)
pile_info_extraction = GhPythonScript(pile_info=list_item_2)  # -> out, area, type, diameter
# ---------- pile_info_extraction: Python ----------
__author__ = "panedviga"
__version__ = "2020.09.09"

import rhinoscriptsyntax as rs
import re

info = pile_info.split('_')

diameter = float(info[0])
type = info[1]
if type == 'circular':
    area = 3.14152696 * diameter **2 / 4
    perimeter = diameter * 3.14152696
    
else:
    area = diameter**2
    perimeter = diameter * 4
# ---------- end pile_info_extraction ----------
number_4 = Number(number)
expression = Expression(loads=graft(number_4), bc=n_kn, Expression="Ceiling(abs(loads)/bc)")
expression_2 = Expression(loads=number_4, bc=graft(n_kn), Expression="Ceiling(abs(loads)/bc)")
mass_addition_2 = MassAddition(Input=expression_2)  # -> Result, PartialResults
panel_11 = Panel("(volume * 8416.94511474 - Count * 53.36874700563749 + Summary_length * 650)/Scale")
panel_12 = Panel(expression_2)
path_mapper_2 = PathMapper(mass_addition_2.Result, source="{a;b}(i)", target="{a}(b)")
panel_13 = Panel(mass_addition_2.Result)
plane_4 = Plane(plane)
text_tag_3d_3 = TextTag3D(Location=plane_4, Text=expression, Size=500, Colour=RGB(0, 255, 0), Justification=1)
multiplication_2 = Multiplication(Length=number_3, Count=path_mapper_2)  # -> simplify(graft(SummaryLength))
number_5 = Number(list_length)
list_item_3 = ListItem(List=explode.Segments, Index=0, Wrap=True)  # -> Item, Item1, Item2, Item3
list_item_4 = ListItem(List=explode.Vertices, Index=3, Wrap=True)
move_2 = Move(Geometry=[list_item_3.Item3, list_item_3.Item2], Motion=graft(unit_z))  # -> Geometry, Transform
text_2 = Text(reverse(flatten(panel_10)))
number_6 = Number(flatten(number_3))
text_3 = Text(flatten([text_2, number_6]))

list_length_2 = ListLength(List=series_6)
multiplication_3 = Multiplication(Area=graft(pile_info_extraction.area), Length=number_3)  # -> simplify(graft(Result))
number_7 = Number(list_length_2)
move_3 = Move(Geometry=list_item_4, Motion=graft(unit_z))  # -> Geometry, Transform

multiplication_4 = Multiplication(_1PileVolume=multiplication_3, ListOfCountsInBushes=mass_addition_2.Result)
panel_14 = Panel(multiplication_4)
evaluate_3 = Evaluate(Expression=panel_11, Volume=panel_14, Summary_length=multiplication_2, Count=panel_13, Scale=number_slider)  # -> simplify(Result)
path_mapper_3 = PathMapper(evaluate_3, source="{a;b}(i)", target="{b;a}(i)")
number_8 = Number(flatten(path_mapper_3))
fitness_landscape = FitnessLandscape(
    Bounds=rectangle,
    Values=expr("x/10", reverse(flatten(number_8))),
    Count=number_5,
    ColourMode=1,
    ContourMode=2,
    Remap=False)
divide_curve = DivideCurve(Curve=[list_item_3.Item, list_item_3.Item3], Count=expr("x-1", [number_5, number_7]), Kinks=False)  # -> Points, Tangents, Parameters
rotate_plane = RotatePlane(Plane=divide_curve.Points, Angle=0.5)
text_tag_3d_4 = TextTag3D(Location=flatten(move_3.Geometry), Text=multiplication, Size=1000, Colour=RGB(255, 255, 255), Justification=9)
text_tag_3d_5 = TextTag3D(
    Location=simplify(flatten(rotate_plane)),
    Text=simplify(flatten(text_3)),
    Size=1000,
    Colour=RGB(140, 255, 194),
    Justification=9)

panel_15 = Panel(number_8)

# ----
# Work with prepared dataset:
# Optimum searching with vertical forces
file_path_2 = FilePath("C:\Users\panedviga\01_Python code\Pile_optimisation\pile_bc.csv")
read_file_2 = ReadFile(File=file_path_2, PerLineParse=True)
length_m_2 = Slider(16, range=10..36, expression="x*0.5")
pile_type = Slider(6, range=1..6)
read_csv_2 = ReadCSV(CSVString=read_file_2, Delimiter=",")  # -> Headers, Values
sub_list_2 = SubList(List=read_csv_2.Values, Domain=Domain(1, 180), Wrap=True)  # -> simplify(List), Index
construct_path_3 = ConstructPath(Indices=pile_type)
construct_path_4 = ConstructPath(Indices=0)
list_item_5 = ListItem(List=read_csv_2.Headers, Index=pile_type, Wrap=True)
tree_branch_3 = TreeBranch(Tree=sub_list_2.List, Path=construct_path_3, MaintainPaths=True)
tree_branch_4 = TreeBranch(Tree=sub_list_2.List, Path=construct_path_4, MaintainPaths=True)
evaluate_4 = Evaluate(Expression="round(x*10)", x=length_m_2)
evaluate_5 = Evaluate(Expression="round(x*10)", x=tree_branch_4)
key_value_search_2 = KeyValueSearch(Keys=evaluate_5, Values=tree_branch_3, Search=evaluate_4)
quick_graph_2 = QuickGraph(tree_branch_3, SortOrder=0)
panel_16 = Panel(list_item_5)
n_kn_2 = Panel(key_value_search_2)
pile_info_extraction_2 = GhPythonScript(pile_info=list_item_5)  # -> out, area, type, diameter; same code as pile_info_extraction
data_recorder = DataRecorder([n_kn_2, pile_type], DataLimit=-10, RecordData=True)
galapagos = Galapagos(fitness=evaluate_6, gene=[pile_type, length_m_2])

number_9 = Number(expr("x*3", pile_info_extraction_2.diameter))
rectangle_2 = Rectangle(Plane=PlaneXY(0, 0, 0), XSize=number_9, YSize=number_9, Radius=0)  # -> Rectangle, Length
number_10 = Number(length_m_2)
rectangle_3 = Rectangle(rectangle_2.Rectangle)

rectangular_array = RectangularArray(Geometry=point, Cell=rectangle_3, XCount=longest_list.ListListA, YCount=longest_list.ListListB)  # -> simplify(Geometry), Transform
average_plane_3 = AveragePlane(Planes=rectangular_array.Geometry)
vector_2pt_2 = Vector2Pt(PointA=average_plane_3, PointB=rectangular_array.Geometry, Unitize=False)  # -> Vector, Length
tree_branch_5 = TreeBranch(Tree=average_plane_3, Path=number_slider_3, MaintainPaths=True)
tree_branch_6 = TreeBranch(Tree=vector_2pt_2.Vector, Path=number_slider_3, MaintainPaths=True)
deconstruct_vector_2 = DeconstructVector(Vector=vector_2pt_2.Vector)  # -> XComponent, YComponent, ZComponent
point_2 = Point(tree_branch_6)
vector_display_2 = VectorDisplay(Anchor=tree_branch_5, Vector=tree_branch_6)
ghpython_script_2 = GhPythonScript(x=deconstruct_vector_2.XComponent, y=deconstruct_vector_2.YComponent)  # -> out, pile_count, sqr_x, sqr_y, max_x, max_y, W_x, W_y; inputs x: list, y: list
# ---------- ghpython_script_2: Python ----------
__author__ = "panedviga"
__version__ = "2020.09.09"

import rhinoscriptsyntax as rs
import Rhino.Geometry

sqr_x = sum(map(lambda n: (n) ** 2, y))
sqr_y = sum(map(lambda n: (n) ** 2, x))
max_x = max(map(lambda n: abs(n), x))
max_y = max(map(lambda n: abs(n), y))
if sqr_x==0:
    W_x = 0
else:
    W_x = sqr_x/max_y
    
if sqr_y==0:
    W_y = 0
else:
    W_y = sqr_y/max_x

pile_count = len(x)
# ---------- end ghpython_script_2 ----------
deconstruct_vector_3 = DeconstructVector(Vector=point_2)  # -> XComponent, YComponent, ZComponent
flip_matrix = FlipMatrix(Data=[concatenate, ghpython_script_2.pile_count, ghpython_script_2.sqr_x, ghpython_script_2.sqr_y, ghpython_script_2.max_x, ghpython_script_2.max_y, ghpython_script_2.W_x, ghpython_script_2.W_y, integer_2, integer])
ghpython_script_3 = GhPythonScript(x=deconstruct_vector_3.XComponent, y=deconstruct_vector_3.YComponent)  # -> out, sqr_x, sqr_y, max_x, max_y, W_x, W_y, flatten(counter); inputs x: list, y: list
# ---------- ghpython_script_3: Python ----------
__author__ = "panedviga"
__version__ = "2020.09.09"

import rhinoscriptsyntax as rs
import Rhino.Geometry

sqr_x = sum(map(lambda n: (n/1000) ** 2, y))
sqr_y = sum(map(lambda n: (n/1000) ** 2, x))
max_x = max(map(lambda n: abs(n/1000), x))
max_y = max(map(lambda n: abs(n/1000), y))
if sqr_x==0:
    W_x = 0
else:
    W_x = max_y/sqr_x
    
if sqr_y==0:
    W_y = 0
else:
    W_y = max_x/sqr_y

counter = len(x)
# ---------- end ghpython_script_3 ----------
create_csv = CreateCSV(DataGridHeaders=panel_9, ValueTree=flip_matrix, Delimiter=",")
panel_17 = Panel(deconstruct_vector_2.YComponent)
panel_18 = Panel([ghpython_script_3.sqr_x, ghpython_script_3.sqr_y, ghpython_script_3.max_x, ghpython_script_3.max_y, ghpython_script_3.W_x, ghpython_script_3.W_y, ghpython_script_3.counter])
panel_19 = Panel(create_csv)

number_11 = Number(pile_info_extraction_2.area)
expression_3 = Expression(loads=number_2, bc=n_kn_2, Expression="Ceiling(abs(loads)/bc)")
multiplication_5 = Multiplication(Area=number_11, Length=length_m_2, ListOfCountsInBushes=flatten(expression_3))
mass_addition_3 = MassAddition(Input=expression_3)  # -> Result, PartialResults
mass_addition_4 = MassAddition(Input=multiplication_5)  # -> PilesVolume, PartialResults
panel_20 = Panel(mass_addition_3.Result)
panel_21 = Panel(mass_addition_4.PilesVolume)
text_tag_3d_6 = TextTag3D(Location=plane_2, Text=expression_3, Size=1000, Colour=RGB(0, 255, 0), Justification=1)
multiplication_6 = Multiplication(A=length_m_2, B=panel_20)

evaluate_6 = Evaluate(Expression=panel, Volume=mass_addition_4.PilesVolume, Summary_length=multiplication_6, Count=panel_20)
price_for_the_foundation_in_millions_of = Panel(evaluate_6)  # "Price for the foundation in millions of roubles"

# ----
# Reading bending moments from autocad
panel_22 = Panel("My")
reference_by_layer_3 = ReferenceByLayer(LayerName=panel_22)
reference_by_layer_4 = ReferenceByLayer(LayerName="Mx")
filter_by_type_2 = FilterByType(Geometry=reference_by_layer_3, ObjectType="Text")
filter_by_type_3 = FilterByType(Geometry=reference_by_layer_4, ObjectType="Text")
deconstruct_text_2 = DeconstructText(TextObject=filter_by_type_2)  # -> Text, Plane, Height, Justification
deconstruct_text_3 = DeconstructText(TextObject=filter_by_type_3)  # -> Text, Plane, Height, Justification
null_item_2 = NullItem(Item=filter_by_type_2)  # -> NullFlags, InvalidFlags, Description
null_item_3 = NullItem(Item=filter_by_type_3)  # -> NullFlags, InvalidFlags, Description
match_text_2 = MatchText(Text=deconstruct_text_2.Text, RegEx="\d*\;\d*", Case=True)
match_text_3 = MatchText(Text=deconstruct_text_3.Text, RegEx="\d*\;\d*", Case=True)
gate_or_2 = GateOr(A=null_item_2.NullFlags, B=match_text_2)
gate_or_3 = GateOr(A=null_item_3.NullFlags, B=match_text_3)
cull_pattern_3 = CullPattern(List=deconstruct_text_3.Plane, CullPattern=invert(gate_or_3))
cull_pattern_4 = CullPattern(List=deconstruct_text_3.Text, CullPattern=invert(gate_or_3))
cull_pattern_5 = CullPattern(List=deconstruct_text_2.Plane, CullPattern=invert(gate_or_2))
cull_pattern_6 = CullPattern(List=deconstruct_text_2.Text, CullPattern=invert(gate_or_2))
location_of_centroids_of_pile_groups = Plane(plane)
closest_point_2 = ClosestPoint(Point=cull_pattern_5, Cloud=location_of_centroids_of_pile_groups)  # -> ClosestPoint, CPIndex, Distance
closest_point_3 = ClosestPoint(Point=cull_pattern_3, Cloud=location_of_centroids_of_pile_groups)  # -> ClosestPoint, CPIndex, Distance
group_numbers = GroupNumbers(Number=closest_point_3.CPIndex)  # -> Keys, Indices
group_numbers_2 = GroupNumbers(Number=closest_point_2.CPIndex)  # -> Keys, Indices
list_item_6 = ListItem(List=cull_pattern_4, Index=group_numbers.Indices, Wrap=True)
list_item_7 = ListItem(List=cull_pattern_6, Index=group_numbers_2.Indices, Wrap=True)
mass_addition_5 = MassAddition(Input=list_item_6)  # -> flatten(Result), PartialResults
mass_addition_6 = MassAddition(Input=list_item_7)  # -> flatten(Result), PartialResults
absolute = Absolute(Value=mass_addition_5.Result)
absolute_2 = Absolute(Value=mass_addition_6.Result)
panel_23 = Panel(absolute)
panel_24 = Panel(absolute_2)

sort_list = SortList(Keys=group_numbers_2.Keys, ValuesValuesA=absolute_2)  # -> Keys, ValuesValuesA
sort_list_2 = SortList(Keys=group_numbers.Keys, ValuesA=absolute)  # -> Keys, ValuesA
text_tag_3d_7 = TextTag3D(Location=location_of_centroids_of_pile_groups, Text=flatten(sort_list_2.ValuesA), Size=500, Justification=7)

larger_than = LargerThan(FirstNumber=sort_list_2.ValuesA, SecondNumber=sort_list.ValuesValuesA)  # -> LargerThan, OrEqualTo
invert_boolean = InvertBoolean(Boolean=larger_than.LargerThan)  # -> Inverted, Number
pick_n_choose = PickNChoose(Pattern=invert_boolean.Inverted, Stream0=absolute, Stream1=absolute_2)
pick_n_choose_2 = PickNChoose(Pattern=larger_than.LargerThan, Stream0=absolute, Stream1=absolute_2)

# ----
# Attaching pile group patterns
file_path_3 = FilePath("C:\Users\panedviga\01_Python code\Pile_optimisation\pile_bush.csv")
read_file_3 = ReadFile(File=file_path_3, PerLineParse=True)
read_csv_3 = ReadCSV(CSVString=read_file_3, Delimiter=",")  # -> Headers, Values
explode_tree = ExplodeTree(Data=read_csv_3.Values)  # -> Branch0, Branch1, Branch2, Branch3, Branch4, Branch5, Branch6, Branch7, Branch8, Branch9
number_12 = Number(number)
text_4 = Text(explode_tree.Branch0)
number_13 = Number([explode_tree.Branch1, explode_tree.Branch2, explode_tree.Branch3, explode_tree.Branch4, explode_tree.Branch5, explode_tree.Branch6, explode_tree.Branch7, explode_tree.Branch8, explode_tree.Branch9])
number_14 = Number(expression_3)
number_15 = Number(n_kn_2)
text_5 = Text([text_4, number_13])
absolute_3 = Absolute(Value=number_12)
longest_list_2 = LongestList(ListListA=number_14, ListListB=number_15, PaddingMode=2)  # -> ListListA, ListListB
flip_matrix_2 = FlipMatrix(Data=text_5)
ghpython_script_4 = GhPythonScript(
    group_properties=flip_matrix_2,
    M_max=pick_n_choose,
    M_min=pick_n_choose_2,
    N_d=absolute_3,
    Preliminary_pile_number=number_14,
    N_max=longest_list_2.ListListB)  # -> out, efficiency_coef, selected_pile_groups, added_piles, coefficiency_of_added_piles, pulling_forces, max_vert_force, min_vert_force, piles_num; inputs group_properties: tree
# ---------- ghpython_script_4: Python ----------
__author__ = "panedviga"
__version__ = "2020.09.10"

import rhinoscriptsyntax as rs
# Инициализируем заведомо неэффективные решения
efficiency_coef = 1000
piles_num = 1000
a = []
    # Итерируемся по всем вариантам свайных кустов. Если находим с меньшим количеством свай - то выбираем его
for branchList in group_properties.Branches:    
    
    n = float(branchList[1])
    W_max = max(float(branchList[6]),0.0001)
    W_min = max(float(branchList[7]),0.0001)
    
    vert_pile_force = N_d / n + M_max / W_max + M_min / W_min
    
    a.append(vert_pile_force)
    if (piles_num > n) & (vert_pile_force < N_max):
        piles_num = n
        efficiency_coef = vert_pile_force / N_max
        selected_pile_groups = branchList[0]
        added_piles = n - Preliminary_pile_number
        coefficiency_of_added_piles =n / Preliminary_pile_number
        pulling_forces = ((N_d / n -( M_max / W_max + M_min / W_min)) < 0)
        max_vert_force = vert_pile_force
        min_vert_force = N_d / n -( M_max / W_max + M_min / W_min)
        b = W_min
        c = N_d / n
# ---------- end ghpython_script_4 ----------
bottom_value = ValueList({"efficiency_coef": 0, "selected_pile_groups": 1, "added_piles": 2, "coefficiency_of_added_piles": 3, "pulling_forces": 4, "max_vert_force": 5, "min_vert_force": 6, "index": 7, "empty": 8}, selected="index")
top_value = ValueList({"efficiency_coef": 0, "selected_pile_groups": 1, "added_piles": 2, "coefficiency_of_added_piles": 3, "pulling_forces": 4, "max_vert_force": 5, "min_vert_force": 6, "index": 7, "empty": 8}, selected="pulling_forces")
integer_4 = Integer(ghpython_script_4.piles_num)
item_index = ItemIndex(List=ghpython_script_4.pulling_forces, Item=ghpython_script_4.pulling_forces)
number_slider_5 = Slider(7, range=0..10, expression="x*100")
stream_filter = StreamFilter(
    Gate=top_value,
    Stream0=ghpython_script_4.efficiency_coef,
    Stream1=ghpython_script_4.selected_pile_groups,
    Stream2=ghpython_script_4.added_piles,
    Stream3=ghpython_script_4.coefficiency_of_added_piles,
    Stream4=ghpython_script_4.pulling_forces,
    Stream5=ghpython_script_4.max_vert_force,
    Stream6=ghpython_script_4.min_vert_force,
    Stream7=item_index)
statistics = Statistics(Series=stream_filter)  # -> SampleMean, Median, Average, StandardDeviation, Skewness, Kurtosis, Variance
stream_filter_2 = StreamFilter(
    Gate=bottom_value,
    Stream0=ghpython_script_4.efficiency_coef,
    Stream1=ghpython_script_4.selected_pile_groups,
    Stream2=ghpython_script_4.added_piles,
    Stream3=ghpython_script_4.coefficiency_of_added_piles,
    Stream4=ghpython_script_4.pulling_forces,
    Stream5=ghpython_script_4.max_vert_force,
    Stream6=ghpython_script_4.min_vert_force,
    Stream7=item_index)
statistics_2 = Statistics(Series=stream_filter_2)  # -> SampleMean, Median, Average, StandardDeviation, Skewness, Kurtosis, Variance
text_tag_3d_8 = TextTag3D(
    Location=simplify(flatten(location_of_centroids_of_pile_groups)),
    Text=simplify(flatten(stream_filter_2)),
    Size=number_slider_5,
    Colour=RGB(186, 255, 140),
    Justification=3)
text_tag_3d_9 = TextTag3D(
    Location=simplify(flatten(location_of_centroids_of_pile_groups)),
    Text=simplify(flatten(stream_filter)),
    Size=number_slider_5,
    Colour=RGB(247, 255, 140),
    Justification=9)
mean_top = Panel(statistics.Average)
mean_bottom = Panel(statistics_2.Average)

# ----
# Final Price
number_16 = Number(number_11)
number_17 = Number(number_10)
integer_5 = Integer(integer_4)
multiplication_7 = Multiplication(Area=number_16, Length=number_17, ListOfCountsInBushes=flatten(integer_5))
mass_addition_7 = MassAddition(Input=integer_5)  # -> Result, PartialResults
mass_addition_8 = MassAddition(Input=multiplication_7)  # -> PilesVolume, PartialResults
panel_25 = Panel(mass_addition_7.Result)
number_18 = Number(number_10)
panel_26 = Panel(mass_addition_8.PilesVolume)
multiplication_8 = Multiplication(A=number_18, B=panel_25)
text_6 = Text(text)
evaluate_7 = Evaluate(Expression=text_6, Volume=mass_addition_8.PilesVolume, Summary_length=multiplication_8, Count=panel_25)
price_for_the_foundation_in_millions_of_2 = Panel(evaluate_7)  # "Price for the foundation in millions of roubles"

# ---- group: Python code solution
# Python code on backgroud solution
# (Deprecated: very slow with bugs)
pile_type_2 = Slider(0, range=0..1)  # disabled
domain = Domain(Domain(1, 2))  # disabled
number_19 = Number(number)  # disabled
list_item_8 = ListItem(List=["circular", "rectangular"], Index=pile_type_2, Wrap=True)  # disabled
length_m_3 = Slider(21, range=10..36, expression="x*0.5")  # disabled
diameter_m = Slider(6, range=6..8, expression="x*0.05")  # disabled
length_m_4 = Slider(21, range=10..36, expression="x*0.5")  # disabled
diameter_m_2 = Slider(6, range=6..8, expression="x*0.05")  # disabled
sub_list_3 = SubList(List=number_19, Domain=domain, Wrap=True)  # -> List, Index; disabled
panel_27 = Panel("36.6")  # disabled
panel_28 = Panel("38.9")  # disabled
panel_29 = Panel("38.5")  # disabled
file_path_4 = FilePath("C:\Users\panedviga\01_Python code\Pile_optimisation\Boring_data_1_18.csv")  # disabled
file_path_5 = FilePath("C:\Users\panedviga\01_Python code\Pile_optimisation\Betta_f.csv")  # disabled
file_path_6 = FilePath("C:\Users\panedviga\01_Python code\Pile_optimisation\Betta1_q.csv")  # disabled
ghpython_script_5 = GhPythonScript(x=number_19, y=number_19)  # -> out, a; disabled
# ---------- ghpython_script_5: Python ----------
__author__ = "panedviga"
__version__ = "2020.09.04"

import rhinoscriptsyntax as rs
a=x+y
# ---------- end ghpython_script_5 ----------
ghpython_script_6 = GhPythonScript(
    Bore_profile_file=file_path_4,
    Betta_f_file=file_path_5,
    Betta1_q_file=file_path_6,
    Bore_elevation=panel_28,
    Pile_top_elevation=panel_29,
    CPT_top_elevation=panel_27,
    Pile_section=pile_type_2,
    Pile_diameter=diameter_m_2,
    Loads_kN=number_19,
    Pile_length=length_m_4)  # -> out, Area, Pile_count, Bearing_capacity, Type; inputs Pile_section: Int32, Loads_kN: list; disabled
# ---------- ghpython_script_6: Python ----------
#!/usr/bin/env python
# coding: utf-8
        
# # Обработка данных статического зондирования скважин
        
# ## Содержание <a id='Content'></a>
        
# [Постановка задачи](#Task_init)    
# [Импорт таблиц СП](SP_tables_import)
        
# Задача данной тетрабки является преобразование неподготовленных результатов статзондирования в удобную форму для машинной обработки. 
        
# ## [Импорт таблиц СП](#Content) <a id='SP_tables_import'></a>
        
# In[1]:
        
"""Provides a scripting component.
    Inputs:
        x: The x script variable
        y: The y script variable
    Output:
        a: The a output variable"""
        
__author__ = "panedviga"
__version__ = "2020.09.03"
        
import rhinoscriptsyntax as rs
import os
import sys
import math
new_path = "C:\\Users\\panedviga\\AppData\\Roaming\\Python\\Python37\\site-packages\\pandas"
if new_path not in sys.path: 
    sys.path.append(new_path)
        
        

import scriptcontext
import ghpythonremote
pd = scriptcontext.sticky['pandas']
np = scriptcontext.sticky['numpy']
skprep = scriptcontext.sticky['sklearn.preprocessing']

        
        




        
        
Betta_f = pd.read_csv(Betta_f_file, sep = ';',decimal=',')
Betta1_q = pd.read_csv(Betta1_q_file, sep = ';',decimal=',')
Betta_f
        
        
# In[4]:
        
        

oe = skprep.LabelEncoder().fit(Betta_f.soil_type)
oe.classes_
        
        
# In[5]:
        
        
Betta_f.soil_type = oe.transform(Betta_f.soil_type)
Betta_f_exit = Betta_f.to_csv()
        
        
# In[6]:
        
        
Boring_data_1_18 = pd.read_csv(Bore_profile_file, 
                               sep = ';',
#                               usecols =[0,1,2,3],
                               decimal=',').dropna(thresh = 3)
#display(Boring_data_1_18.info())
Boring_data_1_18.soil_type = oe.transform(Boring_data_1_18.soil_type)
#Boring_data_1_18.soil_type.value_counts()
#        
#        
## In[7]:
#        
#        
## bore_elevation - отметка скважины
## pile_top_elevation - отметка верха сваи
## CPT_top_elevation - верхняя точка статзондирования
#        
#        
def fill_heigths(data, bore_elevation, pile_top_elevation, CPT_top_elevation):
    elev_delta = bore_elevation - pile_top_elevation
        
    data['pile_length_m'] = data['depth_m'] - elev_delta
    data['abs_elevation_m'] = bore_elevation - data['depth_m'] 
            
    return data
#        
fill_heigths(Boring_data_1_18, 38.9,38.5,36.6)
#        
#        
## In[8]:
#        
#     

f_kPa = pd.DataFrame(Boring_data_1_18.loc[:,'f_kPa'])
f_kPa = f_kPa.merge(Boring_data_1_18.loc[:,'soil_type'],right_index = True, left_index = True).drop_duplicates()
#exit = f_kPa.to_csv()
#
f_kPa = f_kPa.set_index(['soil_type','f_kPa'])
#f_kPa
#        
#        
## In[9]:
#        
#        
Betta_f.set_index(['soil_type','f_kPa'])
#        
#        
## In[10]:
#        
#        
betta_f_merged = pd.concat([Betta_f.set_index(['soil_type','f_kPa']), f_kPa], axis=1)
#betta_f_merged
#        
#        
## In[11]:
#        
#        
betta_f_merged = betta_f_merged.interpolate(method = 'linear', axis = 0)
#betta_f_merged
#        
#        
## In[12]:
#        
#        
Boring_data_1_18 = Boring_data_1_18.merge(betta_f_merged,left_on = ['soil_type','f_kPa'],right_index = True).sort_values('depth_m')
#        
#        
## In[13]:
#        
#        
Boring_data_1_18['q_kPa'] = Boring_data_1_18['q_MPa'] * 1000
#Boring_data_1_18
#        
#        
## In[14]:
#        
#        
q_kPa = pd.DataFrame(Boring_data_1_18.loc[:,'q_kPa']).drop_duplicates()
q_kPa = q_kPa.set_index(['q_kPa'])
#        
Betta1_q_merged = pd.concat([Betta1_q.set_index('q_kPa'), q_kPa], axis=1)
Betta1_q_merged = Betta1_q_merged.interpolate(method = 'linear', axis = 0) 
Boring_data_1_18 = Boring_data_1_18.merge(Betta1_q_merged,left_on = 'q_kPa',right_index = True).sort_values('depth_m')
#        
#        
## In[15]:
#        
#        
#Boring_data_1_18
#        
#        
## In[80]:
#        
#        
#import numpy as np

Area = 0.0

def get_pile_data(bore_profile, diameter, shape):
    # параметры сваи
    if shape == 0:
        area = np.pi * diameter **2 / 4
        perimeter = diameter * np.pi
    else:
        area = diameter **2        
        perimeter = diameter *4 
    Area = area
    
    
    # слои
    pile_data = pd.DataFrame(bore_profile.pile_length_m)
    pile_data['h_i'] = pile_data['pile_length_m'] - pile_data['pile_length_m'].shift()
    pile_data.loc[0,'h_i'] = 0
            
    # сопротивление по острию
    pile_data['R_A'] = bore_profile['q_kPa'] * bore_profile['beta_1'] * area
    pile_data['R_A_averaged'] = pile_data['R_A'].rolling(9,center = True).mean()
            
    # сопротивление по боковой поверхности
    pile_data['side_bearing_cap'] = pile_data['h_i'] * bore_profile['f_kPa'] * bore_profile['beta_i'] * perimeter    
    pile_data['side_bearing_cumulative_summary'] = pile_data['side_bearing_cap'].cumsum()
            
    pile_data['F_u_kN'] = pile_data['R_A'] + pile_data['side_bearing_cumulative_summary']
    pile_data['N_kN'] = pile_data['F_u_kN'] / 1.25
            
    pile_data['N_kN_averaged'] = pile_data['N_kN'].rolling(7,center = True).mean()
            
    return pile_data

if Pile_section == 0:
    Area = np.pi * Pile_diameter **2 / 4
    Type = 'circle'
else:
    Area = Pile_diameter **2   
    type = 'rectangle'



data = get_pile_data(Boring_data_1_18, Pile_diameter,Pile_section)

data['pile_length_m']
Bearing_capacity = float(data.loc[np.round(data['pile_length_m'],1) == Pile_length,'N_kN_averaged'])

Pile_count = []
    
    
for load in Loads_kN:
    Pile_count.append(math.ceil(-load / Bearing_capacity))
#Pile_count_np = ((np.ceil(pd.Series(Loads_kN) / Bearing_capacity)).tolist())
# ---------- end ghpython_script_6 ----------
panel_30 = Panel(ghpython_script_6.Bearing_capacity)  # disabled
mass_addition_9 = MassAddition(Input=ghpython_script_6.Pile_count)  # -> Result, PartialResults; disabled
panel_31 = Panel(ghpython_script_6.Pile_count)  # disabled
panel_32 = Panel(mass_addition_9.Result)  # disabled
galapagos_2 = Galapagos(fitness=mass_addition_10, gene=[diameter_m_2, length_m_4, pile_type_2])
text_tag_3d_10 = TextTag3D(Location=plane_3, Text=ghpython_script_6.Pile_count, Size=500, Colour=RGB(0, 255, 0), Justification=1)  # disabled
bar_graph = BarGraph(ghpython_script_6.Pile_count, BarColor=RGB(255, 0, 90))  # disabled

# ---- group: Python code solution / Optimizing function (material volume)
multiplication_9 = Multiplication(A=ghpython_script_6.Area, B=length_m_4, C=flatten(ghpython_script_6.Pile_count))  # disabled

# ---- group: Python code solution (continued)
mass_addition_10 = MassAddition(Input=multiplication_9)  # -> Result, PartialResults; disabled
panel_33 = Panel(mass_addition_10.Result)  # disabled

# ==== cluster GHPythonRemote: Connects the Grasshopper Python component to an external Python instance.
python = PythonScript()  # -> gh_parent_doc_dir
# ---------- python: Python ----------
from os import path

gh_parent_doc_dir = path.abspath(path.dirname(ghenv.Component.OnPingDocument().Owner.OnPingDocument().FilePath))
# ---------- end python ----------
# GH to python remote example.
# Pierre Cuvilliers, 2017-2018
# Released under the MIT license
# github.com/pilcru/ghpythonremote
# Runs and connects to an external python engine, and
# assigns imported modules to scriptcontext.sticky variables.
# 
# Arguments:
#       code (str): Path to the GH_to_python_sticky.py code file.
#       location (str): Path to a python executable, or to a folder
#             containing `python.exe`, or the name of a conda-created
#             virtual environment prefixed by `conda://` (`conda://env_name`).
#             If empty, finds python from your windows %PATH%.
#       run (boolean): Creates the connection, and imports new
#             modules, when turned to True. Kills the connection,
#             and deletes the references to the imports, when turned
#             to False.
#       modules (str list): List of module names to import in the
#             remote python. They will be added to the
#             scriptcontext.sticky dictionary, allowing them to be
#             reused from other python components in the same
#             Grasshopper document. Submodules (for example
#             `numpy.linalg` have to be added explicitly to this list
#             to be available later.
#       log_level (str from ['NOTSET', 'DEBUG', 'INFO', 'WARNING', 'ERROR', 'CRITICAL']):
#             Logging level to use for the local IronPython and the
#             remote python instance.
#       working_dir (str): Working directory for the remote python
#             instance.
# 
# Returns:
#       out (str): Console output with DEBUG information.
#       linked_modules (str list): list of imported module names.
#       rpy (rpyc connection object): The object representing the
#             remote Python interpreter.
location = ClusterInput()  # location (str): Path to a python executable, or to a folder containing `python.exe`, or the name of a conda-created virtual environment prefixed by `conda://` (`conda://env_name`). If empty, finds python from your windows %PATH%.
run = ClusterInput()  # run (boolean): Creates the connection, and imports new modules, when turned to True. Kills the connection,and deletes the references to the imports, when turned to False.
modules = ClusterInput()  # modules (str list): List of module names to import in the remote python. They will be added to the scriptcontext.sticky dictionary, allowing them to be reused from other python components in the same Grasshopper document. Submodules (for example `numpy.linalg` have to be added explicitly to this list to be available later.
list = ValueList({"CRITICAL", "ERROR", "WARNING", "INFO", "DEBUG", "NOTSET"}, selected="DEBUG")
panel = Panel(python)
ghpythonremote = GHPythonRemote(location=location, run=run, modules=modules, log_level=list, working_dir=panel)  # -> out, linked_modules, rpy; inputs run: Boolean, modules: list
# ---------- ghpythonremote: Python ----------
import inspect
import logging
from os import path
import sys
from time import sleep

import scriptcontext

import ghpythonremote
from ghpythonremote.connectors import GrasshopperToPythonRemote

local_log_level = getattr(logging, log_level, logging.WARNING)
logger = logging.getLogger("ghpythonremote")
logger.setLevel(local_log_level)
ch = logging.StreamHandler()
ch.setLevel(local_log_level)
formatter = logging.Formatter("%(levelname)s: %(name)s:\n%(message)s")
ch.setFormatter(formatter)
logger.handlers = []
logger.addHandler(ch)
logger = logging.getLogger("ghpythonremote.GH_to_python")

ROOT = path.abspath(path.dirname(inspect.getfile(ghpythonremote)))
rpyc_server_py = path.join(ROOT, "pythonservice.py")

# Set connection to CLOSED if this is the first run
# and initialize set of linked modules
try:
    remote_python_status
except NameError:
    remote_python_status = "CLOSED"
    lkd_modules = set()

# Wait for connection to connect or terminate
timer = 0
while remote_python_status == "CONNECTING" or remote_python_status == "CLOSING":
    sleep(1)
    timer += 1
    if timer == 10:
        try:
            gh2py_manager.__exit__(*sys.exc_info())
        except Exception:
            pass
        remote_python_status = "CLOSED"
        lkd_modules = set()
        raise RuntimeError(
            "Connection left in an inconsistent state and not returning. Reset "
            "everything."
        )

if run:
    if not remote_python_status == "OPEN":
        remote_python_status = "CONNECTING"
        gh2py_manager = GrasshopperToPythonRemote(
            rpyc_server_py,
            location=location,
            timeout=10,
            port=None,
            log_level=log_level,
            working_dir=working_dir,
        )
        gh2py = gh2py_manager.__enter__()
        remote_python_status = "OPEN"

    # Stuff that we can reach
    rpymod = gh2py.py_remote_modules  # A getter function for a named python module
    rpy = gh2py.connection  # Represents the remote instance root object
    scriptcontext.sticky["rpy"] = rpy
    # Add modules
    for mod in modules:
        try:
            scriptcontext.sticky[mod] = rpymod(mod)
            lkd_modules.add(mod)
        except ImportError:
            gh2py_manager.__exit__(*sys.exc_info())
            raise

elif not remote_python_status == "CLOSED":
    remote_python_status = "CLOSING"
    # Remove linked modules
    for mod in lkd_modules:
        del scriptcontext.sticky[mod]
    del scriptcontext.sticky["rpy"]
    gh2py_manager.__exit__(*sys.exc_info())
    lkd_modules = set()
    remote_python_status = "CLOSED"

# Change variable name because ghpython resets outputs to None before each run
linked_modules = lkd_modules

logger.info("GH to python connection is {}".format(remote_python_status))
# ---------- end ghpythonremote ----------
out = ClusterOutput(ghpythonremote.out)  # Console output.
linked_modules = ClusterOutput(ghpythonremote.linked_modules)  # Names of modules that were successfully added to the scriptcontext.sticky dictionary.
rpy = ClusterOutput(ghpythonremote.rpy)  # The object representing the remote python instance
python_2 = PythonScript(module_names=ghpythonremote.linked_modules)  # -> import_statements; inputs module_names: list
# ---------- python_2: Python ----------
import_statements = ["import scriptcontext as sc"]
for module_name in module_names:
    import_statements.append("{0} = sc.sticky['{0}']".format(module_name))

if len(module_names) == 0:
    import_statements = []
# ---------- end python_2 ----------
import_statements = ClusterOutput(python_2)  # Useful import statements to use the imported modules in your scripts.
